# Grasshopper definition Railway_190116_PSH.gh (Grasshopper 1.0.7)
# plug-ins: RailwayPlanner, ElkGHComponents

number_slider = Slider(6610000, range=0..10000000)
number_slider_2 = Slider(370000, range=0..1000000)
number_slider_3 = Slider(6650000, range=0..10000000)
number_slider_4 = Slider(340000, range=0..1000000)
dom = ConstructDomain(DomainStart=number_slider_4, DomainEnd=number_slider_2)
dom_2 = ConstructDomain(DomainStart=number_slider, DomainEnd=number_slider_3)
path = FilePath("C:\Users\pihise\Documents\GitHub\GH_Files\nh_66_3.tif")
topo = Topography(FilePath=path, Longitude=dom, Latitude=dom_2)  # -> FileInfo, Points, Curves, Surface
pt = Point(topo.Points)
pdecon = Deconstruct(Point=pt)  # -> XComponent, YComponent, ZComponent
panel = Panel(topo.FileInfo)
smaller = SmallerThan(FirstNumber=pdecon.ZComponent, SecondNumber=0)  # -> SmallerThan, OrEqualTo
cull = CullPattern(List=pt, CullPattern=invert(smaller.OrEqualTo))
pdecon_2 = Deconstruct(Point=cull)  # -> XComponent, YComponent, ZComponent
multiplication = Multiplication(A=pdecon_2.ZComponent, B=Slider(1, range=1..10))
pt_2 = ConstructPoint(XCoordinate=pdecon_2.XComponent, YCoordinate=pdecon_2.YComponent, ZCoordinate=multiplication)
pt_3 = Point(flatten(pt_2))

# ----
# Mesh
del = DelaunayMesh(Points=pt_3, Plane=PlaneXY(0, 0, 0))

mesh = Mesh(del)
bbox = BoundingBox(Content=mesh, Plane=PlaneXY(0, 0, 0))  # -> Box, Box_2
debox = DeconstructBox(Box=bbox.Box)  # -> Plane, X, Y, Z
subtraction = Subtraction(A=number_slider_2, B=number_slider_4)
subtraction_2 = Subtraction(A=number_slider_3, B=number_slider)
dedomain = DeconstructDomain(Domain=debox.X)  # -> Start, End
dedomain_2 = DeconstructDomain(Domain=debox.Y)  # -> Start, End
neg = Negative(Value=dedomain.Start)
num = Number(subtraction)
num_2 = Number(subtraction_2)
num_3 = Number(neg)
num_4 = Number(dedomain_2.End)
division = Division(A=num_2, B=num_4)
division_2 = Division(A=num, B=num_3)
scale_nu = ScaleNU(Geometry=mesh, Plane=PlaneXY(0, 0, 0), ScaleX=division_2, ScaleY=division, ScaleZ=1)  # -> Geometry, Transform
mirror = Mirror(Geometry=scale_nu.Geometry, Plane=PlaneYZ(0, 0, 0))  # -> Geometry, Transform
mesh_2 = Mesh(mirror.Geometry)
contour = Contour(Shape=mirror.Geometry, Point=Point(0, 0, 0), Direction=Vector(0, 0, 10), Distance=10)
crv = Curve(contour)
c_script = CSharpScript(G=crv, view="Top")  # -> out; inputs G: tree of Curve, view: String
# ---------- c_script: C# usings ----------
using System.IO;
using System.Linq;
using System.Data;
using System.Drawing;
using System.Reflection;
using System.Windows.Forms;
using System.Xml;
using System.Xml.Linq;
using System.Runtime.InteropServices;

using Rhino.DocObjects;
using Rhino.Collections;
using GH_IO;
using GH_IO.Serialization;
# ---------- c_script: C# ----------
    geometry = G;
    viewport = view;
# ---------- c_script: C# additional code ----------
  DataTree<Curve> geometry;
  String viewport;

  //Return a BoundingBox that contains all the geometry you are about to draw.
  public override BoundingBox ClippingBox
  {
    get
    {
      return BoundingBox.Empty;
    }
  }

  //Draw all meshes in this method.
  public override void DrawViewportMeshes(IGH_PreviewArgs args)
  {
    //Rhino.RhinoApp.WriteLine(args.Display.Viewport.Name);
    if(args.Display.Viewport.Name == viewport)
      foreach(GH_Path path in geometry.Paths)
        foreach(Curve b in geometry.Branch(path))
          args.Display.DrawCurve(b, System.Drawing.Color.CadetBlue);
  }

  //Draw all wires and points in this method.
  public override void DrawViewportWires(IGH_PreviewArgs args)
  {
  }
# ---------- end c_script ----------
vec = Vector(Vector(0, 0, 0))
swatch = ColourSwatch(SwatchColor=RGB(95, 199, 255))
col = Colour(swatch)
series = Series(Start=0, Step=Slider(0.0005, range=0..0.001), Count=Slider(2001, range=0..10000))
number_slider_5 = Slider(1, range=0..1)
Z = UnitZ(Factor=Slider(5, range=0..10))
neg_2 = Negative(Value=Z)
number_slider_6 = Slider(15, range=0..100)
number_slider_7 = Slider(10, range=0..10)
number_slider_8 = Slider(5, range=0..10)
number_slider_9 = Slider(20, range=0..100)
neg_3 = Negative(Value=Slider(15, range=0..100))
neg_4 = Negative(Value=Slider(20, range=0..100))
Z_2 = UnitZ(Factor=Slider(21, range=0..100))
Z_3 = UnitZ(Factor=Slider(34, range=0..100))

panel_2 = Panel("Input curve")
crv_2 = Curve(<curve referenced from the Rhino model>)
Z_4 = UnitZ(Factor=Slider(3000, range=0..10000))
neg_5 = Negative(Value=Z_4)

radiuscheck = CheckRailCurveRadius(Curve=crv_2)

extr = Extrude(Base=radiuscheck, Direction=neg_5)
mesh_uv = MeshSurface(Surface=extr, UCount=Slider(100, range=0..1000), VCount=Slider(500, range=0..1000), Overhang=True, Equalize=False)
mesh_3 = Mesh(mesh_uv)
mmx = MeshMesh(MeshA=mesh_2, MeshB=mesh_3, UseMeshMeshFast=True)
crv_3 = Curve(reparameterize(mmx))

# ----
# New Interpolated Crv
number_slider_10 = Slider(100, range=0..500)
crv_4 = Curve(reparameterize(crv_3))
divide = DivideCurve(Curve=crv_4, Count=number_slider_10, Kinks=False)  # -> Points, Tangents, Parameters
intcrv = Interpolate(Vertices=divide.Points, Degree=5, Periodic=False, KnotStyle=1)  # -> Curve, Length, Domain
crv_cp = CurveClosestPoint(Point=divide.Points, Curve=intcrv.Curve)  # -> Point, Parameter, Distance
pt_4 = Point(crv_cp.Point)

# ----
# Mean CRV/Polyline
pt_5 = Point(pt_4)
crv_5 = Curve(reparameterize(crv_3))
lng = ListLength(List=pt_5)
end = EndPoints(Curve=crv_5)  # -> Start, End
pdecon_3 = Deconstruct(Point=pt_5)  # -> XComponent, YComponent, ZComponent
pline = PolyLine(Vertices=pt_5, Closed=False)
series_2 = Series(Start=0, Step=1, Count=lng)
item = ListItem(List=series_2, Index=-1, Wrap=True)
pdecon_4 = Deconstruct(Point=end.End)  # -> XComponent, YComponent, ZComponent
pdecon_5 = Deconstruct(Point=end.Start)  # -> XComponent, YComponent, ZComponent
division_3 = Division(A=series_2, B=item)
subtraction_3 = Subtraction(A=pdecon_4.ZComponent, B=pdecon_5.ZComponent)
multiplication_2 = Multiplication(A=division_3, B=subtraction_3)
addition = Addition(A=pdecon_5.ZComponent, B=multiplication_2)
pt_6 = ConstructPoint(XCoordinate=pdecon_3.XComponent, YCoordinate=pdecon_3.YComponent, ZCoordinate=addition)
pline_2 = PolyLine(Vertices=pt_6, Closed=False)
crv_6 = Curve(pline_2)

crv_7 = Curve(crv_2)

# ----
# Radius
curvature = Curvature(Curve=intcrv.Curve, Parameter=crv_cp.Parameter)  # -> P, K, C
darc = DeconstructArc(Arc=curvature.C)  # -> BasePlane, Radius, Angle
sort = SortList(Keys=darc.Radius)  # -> Keys, ValuesA
panel_3 = Panel(sort.Keys)

# ----
# Inclination
pt_7 = Point(pt_4)
shift = ShiftList(List=pt_7, Shift=1, Wrap=False)
shift_2 = ShiftList(List=pt_7, Shift=-1, Wrap=False)
vec2pt = Vector2Pt(PointA=shift, PointB=shift_2, Unitize=False)  # -> Vector, Length
xy = XYPlane(Origin=Point(0, 0, 0))
project = Project(Geometry=vec2pt.Vector, Plane=xy)  # -> Geometry, Transform
angle = Angle(VectorA=project.Geometry, VectorB=vec2pt.Vector)  # -> Angle, Reflex
deg = Degrees(Radians=angle.Angle)
sort_2 = SortList(Keys=deg)  # -> Keys, ValuesA
panel_4 = Panel(sort_2.Keys)

c_script_2 = CSharpScript(G=crv_7, view="Top")  # -> out; inputs G: tree of Curve, view: String
# ---------- c_script_2: C# ----------
    geometry = G;
    viewport = view;
# ---------- c_script_2: C# additional code ----------
  DataTree<Curve> geometry;
  String viewport;

  //Return a BoundingBox that contains all the geometry you are about to draw.
  public override BoundingBox ClippingBox
  {
    get
    {
      return BoundingBox.Empty;
    }
  }

  //Draw all meshes in this method.
  public override void DrawViewportMeshes(IGH_PreviewArgs args)
  {
    
    //Rhino.RhinoApp.WriteLine(args.Display.Viewport.Name);
    if(args.Display.Viewport.Name == viewport)
      foreach(GH_Path path in geometry.Paths)
        foreach(Curve b in geometry.Branch(path))
          args.Display.DrawCurve(b, System.Drawing.Color.Black, 3);
  }

  //Draw all wires and points in this method.
  public override void DrawViewportWires(IGH_PreviewArgs args)
  {
  }
# ---------- end c_script_2 ----------

# ----
# Polyline
pt_8 = Point(crv_cp.Point)
pline_3 = PolyLine(Vertices=pt_8, Closed=False)
crv_8 = Curve(crv_4)

# ----
# Rotated PLine
crv_9 = Curve(crv_8)
explode = Explode(Curve=crv_9, Recursive=True)  # -> Segments, Vertices
xy_2 = XYPlane(Origin=Point(0, 0, 0))
yz = YZPlane(Origin=Point(0, 0, 0))
Y = UnitY(Factor=1)
angle_2 = Angle(VectorA=explode.Segments, VectorB=Y, Plane=xy_2)  # -> Angle, Reflex
end_2 = EndPoints(Curve=explode.Segments)  # -> Start, End
xy_3 = XYPlane(Origin=end_2.Start)
rotate = Rotate(Geometry=explode.Segments, Angle=angle_2.Angle, Plane=xy_3)  # -> Geometry, Transform
crv_10 = Curve(rotate.Geometry)

# ----
# Moved PLine
crv_11 = Curve(crv_10)
shift_3 = ShiftList(List=crv_11, Shift=1, Wrap=False)
crv_12 = Curve(crv_11)
end_3 = EndPoints(Curve=crv_12)  # -> Start, End
end_4 = EndPoints(Curve=shift_3)  # -> Start, End
vec2pt_2 = Vector2Pt(PointA=end_3.End, PointB=end_4.Start, Unitize=False)  # -> Vector, Length

cull_i = CullIndex(List=vec2pt_2.Vector, Indices=-1, Wrap=True)

ma = MassAddition(Input=cull_i)  # -> Result, PartialResults
vec_2 = Vector(flatten(ma.PartialResults))
vec_3 = Vector([vec, vec_2])
rev = Reverse(Vector=vec_3)
move = Move(Geometry=crv_11, Motion=rev)  # -> Geometry, Transform
crv_13 = Curve(move.Geometry)

# ----
# Dimensions
crv_14 = Curve(crv_13)
join = JoinCurves(Curves=crv_14, Preserve=False)
crv_15 = Curve(join)
end_5 = EndPoints(Curve=crv_14)  # -> Start, End
end_6 = EndPoints(Curve=crv_15)  # -> Start, End
pdecon_6 = Deconstruct(Point=end_6.Start)  # -> XComponent, YComponent, ZComponent
pdecon_7 = Deconstruct(Point=end_6.End)  # -> XComponent, YComponent, ZComponent
pt_9 = Point(flatten([end_5.Start, end_6.End]))
mid_on_curve = MidOnCurve(crv=crv_14)  # -> flatten(pt)
angle_3 = Angle(VectorA=Vector(0, 1, 0), VectorB=crv_14)  # -> Angle, Reflex
addition_2 = Addition(A=pdecon_6.ZComponent, B=Slider(5000, range=0..10000))
deg_2 = Degrees(Radians=angle_3.Angle)
pt_10 = ConstructPoint(XCoordinate=pdecon_6.XComponent, YCoordinate=pdecon_6.YComponent, ZCoordinate=addition_2)
pt_11 = ConstructPoint(XCoordinate=pdecon_7.XComponent, YCoordinate=pdecon_7.YComponent, ZCoordinate=addition_2)
linedim = LineDimension(Line=crv_14, Text="{0:0.00}", Size=10)
round = Round(number=deg_2, decimals=1)
ln = Line(StartPoint=pt_10, EndPoint=pt_11)
special_text = SpecialTextTag(tag=round, loc=mid_on_curve, siz=10)  # inputs tag: String, loc: Point3d, siz: Double
# ---------- special_text: C# ----------
    if (string.IsNullOrWhiteSpace(tag))
      return;

    _text.Add(tag);
    _point.Add(loc);
    _size.Add(siz);
# ---------- special_text: C# additional code ----------
  private readonly List<string> _text = new List<string>();
  private readonly List<Point3d> _point = new List<Point3d>();
  private readonly List<double> _size = new List<double>();

  public override void BeforeRunScript()
  {
    _text.Clear();
    _point.Clear();
    _size.Clear();
  }

  public override BoundingBox ClippingBox
  {
    get
    {
      return BoundingBox.Empty;
    }
  }
  public override void DrawViewportWires(IGH_PreviewArgs args)
  {
    if (_text.Count == 0)
      return;

    Plane plane;
    args.Viewport.GetFrustumFarPlane(out plane);

    for (int i = 0; i < _text.Count; i++)
    {
      string text = _text[i];
      double size = _size[i];
      Point3d point = _point[i];
      plane.Origin = point;

      // Figure out the size. This means measuring the visible size in the viewport AT the current location.
      double pixPerUnit;
      Rhino.Display.RhinoViewport viewport = args.Viewport;
      viewport.GetWorldToScreenScale(point, out pixPerUnit);

      size = size / pixPerUnit;

      Rhino.Display.Text3d drawText = new Rhino.Display.Text3d(text, plane, size);
      args.Display.Draw3dText(drawText, Color.Firebrick);
      drawText.Dispose();
    }
  }
# ---------- end special_text ----------
serialdim = SerialDimension(Line=ln, Points=pt_9, Text="{0:0.00}", Size=300)

# ----
# Create Interpolate curve and lets user adjust
number_slider_11 = Slider(27650, range=0..100000)
crv_16 = Curve(crv_13)
lng_2 = ListLength(List=crv_16)
division_4 = Division(A=lng_2, B=10)
int = Integer(division_4)
join_2 = JoinCurves(Curves=crv_16, Preserve=False)
divide_2 = DivideCurve(Curve=join_2, Count=int, Kinks=False)  # -> Points, Tangents, Parameters
pdecon_8 = Deconstruct(Point=divide_2.Points)  # -> XComponent, YComponent, ZComponent
pt_12 = ConstructPoint(XCoordinate=pdecon_8.XComponent, YCoordinate=pdecon_8.YComponent, ZCoordinate=expr("x*10", pdecon_8.ZComponent))
crv_17 = Curve(join_2)
end_7 = EndPoints(Curve=crv_17)  # -> Start, End
ln_2 = Line(StartPoint=end_7.Start, EndPoint=end_7.End)
button = Button()

vec_4 = VectorXYZ(XComponent=0, YComponent=number_slider_11, ZComponent=expr("x/100", number_slider_11))  # -> Vector, Length

move_2 = Move(Geometry=pt_12, Motion=vec_4.Vector)  # -> Geometry, Transform
pline_4 = PolyLine(Vertices=move_2.Geometry, Closed=False)
profile_crv = Curve(pline_4)
cp = ControlPoints(Curve=profile_crv)  # -> Points, Weights, Knots
cull_2 = CullPattern(List=cp.Points, CullPattern=[True, False, False, False, False])
pline_5 = PolyLine(Vertices=cull_2, Closed=False)
crvadjust = AdjustCurve(Curve=pline_5, Reset=button, Layername="Landscape Profile", Color=swatch, Locked=False)
crvadjust_2 = AdjustCurve(
    Curve=profile_crv,
    Reset=button,
    Layername="Rail Profile",
    Color=ColourSwatch(SwatchColor=RGB(217, 130, 152)),
    Locked=False)
topography_crv = Curve(crvadjust_2)
profile_crv_2 = Curve(crvadjust)

inclinationcheck = CheckRailCurveInclination(Curve=topography_crv, CurveScale=10)
inclinationcheck_2 = CheckRailCurveInclination(Curve=profile_crv_2, CurveScale=10)
profile_crv_3 = Curve(reparameterize(topography_crv))
rail_crv = Curve(reparameterize(profile_crv_2))
eval = EvaluateCurve(Curve=profile_crv_3, Parameter=series)  # -> Point, Tangent, Angle
xz = XZPlane(Origin=eval.Point)
pcx = CurvePlane(Curve=rail_crv, Plane=xz)  # -> flatten(Points), ParamsC, ParamsP
xz_2 = XZPlane(Origin=pcx.Points)
pcx_2 = CurvePlane(Curve=profile_crv_3, Plane=xz_2)  # -> flatten(Points), ParamsC, ParamsP
vec2pt_3 = Vector2Pt(PointA=pcx.Points, PointB=pcx_2.Points, Unitize=False)  # -> Vector, Length
item_2 = ListItem(List=pcx.Points, Index=Slider(1923, range=0..10000), Wrap=True)
pdecon_9 = Deconstruct(Point=vec2pt_3.Vector)  # -> XComponent, YComponent, ZComponent
lng_3 = ListLength(List=pcx.Points)
num_5 = Number(expr("(x*-1)/10", pdecon_9.ZComponent))
round_2 = Round(Number=pdecon_9.ZComponent)  # -> Nearest, Floor, Ceiling
hi = HeightIdentifier(ZValue=expr("x/10", round_2.Ceiling))  # -> Low, Mid1, Mid2, High, Cut, Tunnel
c_script_3 = CSharpScript(x=hi.Low, y=lng_3)  # -> out, A; inputs x: list of Int32, y: Int32
# ---------- c_script_3: C# ----------
    List<List<int>> groupedPts = new List<List<int>>();
    DataTree<int> boolTree = new DataTree<int>();
    List<int> tempList = new List<int>();
    for (int i = 1; i < x.Count; i++)
    {
      if ((x[i] - x[i - 1]) == 1 && i != x.Count - 1)
        tempList.Add(x[i - 1]);
      else if ((x[i] - x[i - 1]) == 1 && i == x.Count - 1)
      {
        tempList.Add(x[i - 1]);
        tempList.Add(x[i]);
        if (x[i] + 1 <= y-1 )
        tempList.Add(x[i] + 1);
      }
      else
      {
        tempList.Add(x[i - 1]);
        tempList.Add(x[i - 1] + 1);
        groupedPts.Add(tempList);
        tempList = new List<int>();
      }
    }

    groupedPts.Add(tempList);
    int pathId = 0;

    foreach (List<int> list in groupedPts)
    {
      GH_Path pth = new GH_Path(pathId);
      foreach (int index in list)
      {
        boolTree.Add(index, pth);
      }

      pathId++;
    }

    A = boolTree;
# ---------- end c_script_3 ----------
c_script_4 = CSharpScript(x=hi.Mid1, y=lng_3)  # -> out, A; inputs x: list of Int32, y: Int32; same code as c_script_3
c_script_5 = CSharpScript(x=hi.Mid2, y=lng_3)  # -> out, A; inputs x: list of Int32, y: Int32; same code as c_script_3
c_script_6 = CSharpScript(x=hi.High, y=lng_3)  # -> out, A; inputs x: list of Int32, y: Int32; same code as c_script_3
c_script_7 = CSharpScript(x=hi.Cut, y=lng_3)  # -> out, A; inputs x: list of Int32, y: Int32; same code as c_script_3
c_script_8 = CSharpScript(x=hi.Tunnel, y=lng_3)  # -> out, A; inputs x: list of Int32, y: Int32; same code as c_script_3
item_3 = ListItem(List=pcx.Points, Index=c_script_3.A, Wrap=True)
item_4 = ListItem(List=num_5, Index=c_script_3.A, Wrap=True)
item_5 = ListItem(List=pcx.Points, Index=c_script_4.A, Wrap=True)
item_6 = ListItem(List=num_5, Index=c_script_6.A, Wrap=True)
item_7 = ListItem(List=num_5, Index=c_script_7.A, Wrap=True)
item_8 = ListItem(List=num_5, Index=c_script_4.A, Wrap=True)
item_9 = ListItem(List=num_5, Index=c_script_5.A, Wrap=True)
avr = Average(Input=item_4)  # -> flatten(ArithmeticMean)
item_10 = ListItem(List=pcx.Points, Index=c_script_6.A, Wrap=True)
item_11 = ListItem(List=num_5, Index=c_script_8.A, Wrap=True)
item_12 = ListItem(List=pcx.Points, Index=c_script_7.A, Wrap=True)
item_13 = ListItem(List=pcx.Points, Index=c_script_5.A, Wrap=True)
avr_2 = Average(Input=item_6)  # -> flatten(ArithmeticMean)
intcrv_2 = Interpolate(Vertices=item_3, Degree=3, Periodic=False, KnotStyle=1)  # -> flatten(Curve), Length, Domain
avr_3 = Average(Input=item_7)  # -> flatten(ArithmeticMean)
item_14 = ListItem(List=pcx.Points, Index=c_script_8.A, Wrap=True)
avr_4 = Average(Input=item_8)  # -> flatten(ArithmeticMean)
avr_5 = Average(Input=item_9)  # -> flatten(ArithmeticMean)
intcrv_3 = Interpolate(Vertices=item_5, Degree=3, Periodic=False, KnotStyle=1)  # -> flatten(Curve), Length, Domain
avr_6 = Average(Input=item_11)  # -> flatten(ArithmeticMean)
intcrv_4 = Interpolate(Vertices=item_10, Degree=3, Periodic=False, KnotStyle=1)  # -> flatten(Curve), Length, Domain
intcrv_5 = Interpolate(Vertices=item_12, Degree=3, Periodic=False, KnotStyle=1)  # -> flatten(Curve), Length, Domain
intcrv_6 = Interpolate(Vertices=item_13, Degree=3, Periodic=False, KnotStyle=1)  # -> flatten(Curve), Length, Domain
intcrv_7 = Interpolate(Vertices=item_14, Degree=3, Periodic=False, KnotStyle=1)  # -> flatten(Curve), Length, Domain
panel_5 = Panel(avr)
move_3 = Move(Geometry=intcrv_3.Curve, Motion=Z)  # -> Geometry, Transform
move_4 = Move(Geometry=intcrv_3.Curve, Motion=neg_2)  # -> Geometry, Transform
move_5 = Move(Geometry=intcrv_4.Curve, Motion=Z)  # -> Geometry, Transform
move_6 = Move(Geometry=intcrv_4.Curve, Motion=neg_2)  # -> Geometry, Transform
move_7 = Move(Geometry=intcrv_5.Curve, Motion=Z)  # -> Geometry, Transform
move_8 = Move(Geometry=intcrv_5.Curve, Motion=neg_2)  # -> Geometry, Transform
move_9 = Move(Geometry=intcrv_6.Curve, Motion=Z)  # -> Geometry, Transform
move_10 = Move(Geometry=intcrv_6.Curve, Motion=neg_2)  # -> Geometry, Transform
move_11 = Move(Geometry=intcrv_7.Curve, Motion=Z)  # -> Geometry, Transform
move_12 = Move(Geometry=intcrv_7.Curve, Motion=neg_2)  # -> Geometry, Transform
move_13 = Move(Geometry=intcrv_2.Curve, Motion=Z)  # -> Geometry, Transform
move_14 = Move(Geometry=intcrv_2.Curve, Motion=neg_2)  # -> Geometry, Transform
entwine = Entwine(Branch00=move_3.Geometry, Branch01=move_4.Geometry, FlattenInputs=True)
entwine_2 = Entwine(Branch00=move_5.Geometry, Branch01=move_6.Geometry, FlattenInputs=True)
entwine_3 = Entwine(Branch00=move_7.Geometry, Branch01=move_8.Geometry, FlattenInputs=True)
entwine_4 = Entwine(Branch00=move_9.Geometry, Branch01=move_10.Geometry, FlattenInputs=True)
entwine_5 = Entwine(Branch00=move_11.Geometry, Branch01=move_12.Geometry, FlattenInputs=True)
entwine_6 = Entwine(Branch00=move_13.Geometry, Branch01=move_14.Geometry, FlattenInputs=True)
flip = FlipMatrix(Data=entwine)
flip_2 = FlipMatrix(Data=entwine_2)
flip_3 = FlipMatrix(Data=entwine_3)
flip_4 = FlipMatrix(Data=entwine_6)
flip_5 = FlipMatrix(Data=entwine_4)
flip_6 = FlipMatrix(Data=entwine_5)
loft = Loft(Curves=flip, Options={Adjust=False, Closed=False, LoftEnds=0, LoftSimp=0, LoftType=0, Rebuild=10, Refit=0.01})  # -> flatten(Loft)
loft_2 = Loft(Curves=flip_2, Options={Adjust=False, Closed=False, LoftEnds=0, LoftSimp=0, LoftType=0, Rebuild=10, Refit=0.01})  # -> flatten(Loft)
loft_3 = Loft(Curves=flip_3, Options={Adjust=False, Closed=False, LoftEnds=0, LoftSimp=0, LoftType=0, Rebuild=10, Refit=0.01})  # -> flatten(Loft)
loft_4 = Loft(Curves=flip_4, Options={Adjust=False, Closed=False, LoftEnds=0, LoftSimp=0, LoftType=0, Rebuild=10, Refit=0.01})  # -> flatten(Loft)
loft_5 = Loft(Curves=flip_5, Options={Adjust=False, Closed=False, LoftEnds=0, LoftSimp=0, LoftType=0, Rebuild=10, Refit=0.01})  # -> flatten(Loft)
loft_6 = Loft(Curves=flip_6, Options={Adjust=False, Closed=False, LoftEnds=0, LoftSimp=0, LoftType=0, Rebuild=10, Refit=0.01})  # -> flatten(Loft)
preview = CustomPreview(Geometry=loft, Material=ColourSwatch(SwatchColor=RGB(232, 252, 101)))
preview_2 = CustomPreview(Geometry=loft_4, Material=ColourSwatch(SwatchColor=RGB(81, 240, 142)))
merge = Merge(Data1=intcrv_2.Curve, Data2=intcrv_3.Curve, Data3=intcrv_4.Curve)  # -> flatten(Result)
preview_3 = CustomPreview(Geometry=loft_2, Material=ColourSwatch(SwatchColor=RGB(255, 97, 97)))
preview_4 = CustomPreview(Geometry=loft_3, Material=ColourSwatch(SwatchColor=RGB(156, 120, 50)))
preview_5 = CustomPreview(Geometry=loft_5, Material=ColourSwatch(SwatchColor=RGB(235, 120, 179)))
preview_6 = CustomPreview(Geometry=loft_6, Material=ColourSwatch(SwatchColor=RGB(0, 0, 0)))
simplify = SimplifyCurve(Curve=merge)  # -> Curve, Simplified
crv_18 = Curve(simplify.Curve)
cr = CreateRoad(SegmentCrv=intcrv_4.Curve, Height=avr_2)
cr_2 = CreateRoad(SegmentCrv=intcrv_3.Curve, Height=avr_4)
cr_3 = CreateRoad(SegmentCrv=intcrv_6.Curve, Height=avr_5)
cr_4 = CreateRoad(SegmentCrv=intcrv_2.Curve, Height=avr)
cr_5 = CreateRoad(SegmentCrv=intcrv_5.Curve, Height=avr_3)
cr_6 = CreateRoad(SegmentCrv=intcrv_7.Curve, Height=avr_6)
merge_2 = Merge(Data1=cr_4, Data2=cr_2, Data3=cr_3, Data4=cr, Data5=cr_5, Data6=cr_6)
rclassifier = RailClassifier(Road=merge_2)  # -> SegmentCurve, simplify(RoadTypes)
flip_7 = FlipMatrix(Data=rclassifier.RoadTypes)
curvepoint = PointOnCurve(rclassifier.SegmentCurve, parameter=0.5)
branch = TreeBranch(Tree=flip_7, Path=Slider(1, range=0..100), MaintainPaths=True)
branch_2 = TreeBranch(Tree=flip_7, Path=Slider(0, range=0..100), MaintainPaths=True)
move_15 = Move(Geometry=curvepoint, Motion=Z_2)  # -> Geometry, Transform
move_16 = Move(Geometry=curvepoint, Motion=Z_3)  # -> Geometry, Transform
tag = TextTag(Location=move_15.Geometry, Text=branch_2)
price_calculator = CSharpScript(
    roadType=branch_2,
    bankLow="10000",
    bankHigh="15000",
    bridgeLow="50000",
    bridgeHigh="75000",
    cut="60000",
    tunnel="120000")  # -> out, A; inputs roadType: String, bankLow: Double, bankHigh: Double, bridgeLow: Double, bridgeHigh: Double, cut: Double, tunnel: Double
# ---------- price_calculator: C# ----------
    double price = 0;

    if (roadType == "Bank Low")
      price = bankLow;

    if (roadType == "Bank High")
      price = bankHigh;

    if (roadType == "Bridge Low")
      price = bridgeLow;

    if (roadType == "Bridge High")
      price = bridgeHigh;

    if (roadType == "Cut")
      price = cut;

    if (roadType == "Tunnel")
      price = tunnel;

    A = price;
# ---------- end price_calculator ----------
tag_2 = TextTag(Location=move_16.Geometry, Text=branch)
end_8 = EndPoints(Curve=rclassifier.SegmentCurve)  # -> Start, End
pdecon_10 = Deconstruct(Point=end_8.Start)  # -> XComponent, YComponent, expr("x/10", ZComponent)
pdecon_11 = Deconstruct(Point=end_8.End)  # -> XComponent, YComponent, expr("x/10", ZComponent)
pt_13 = ConstructPoint(XCoordinate=pdecon_11.XComponent, YCoordinate=pdecon_11.YComponent, ZCoordinate=pdecon_11.ZComponent)
pt_14 = ConstructPoint(XCoordinate=pdecon_10.XComponent, YCoordinate=pdecon_10.YComponent, ZCoordinate=pdecon_10.ZComponent)
ln_3 = Line(StartPoint=pt_14, EndPoint=pt_13)
len = Length(Curve=ln_3)
multiplication_3 = Multiplication(A=len, B=price_calculator.A)
ma_2 = MassAddition(Input=multiplication_3)  # -> Result, PartialResults
division_5 = Division(A=ma_2.Result, B=Slider(1000000, range=0..1000000))
round_3 = Round(Number=division_5)  # -> Nearest, Floor, Ceiling
join_3 = TextJoin(Text=[round_3.Ceiling, "        Mkr"])
panel_6 = Panel(join_3)

# ==== cluster MidOnCurve: Parameter mid on a curve object
crv = ClusterInput()
crv_2 = Curve(crv)
end = EndPoints(Curve=crv_2)  # -> Start, End
mid2pts = MidBetweenTwoPoints(pt=end.Start, pt_2=end.End)
pt = ClusterOutput(mid2pts)

# ==== cluster Round: Rounds Value with number of decimals
number = ClusterInput()  # Number to round
decimals = ClusterInput()  # Number of decimals
_10º = PowerOf10(Value=decimals)
multiplication = Multiplication(A=number, B=_10º)
int = Integer(multiplication)
division = Division(A=int, B=_10º)
nearest = ClusterOutput(division)  # Nearest Value

# ==== cluster MidBetweenTwoPoints: Get the midpoint between two points
pt = ClusterInput()
pt_2 = ClusterInput()
pt_3 = Point(pt)
pt_4 = Point(pt_2)
ln = Line(StartPoint=pt_3, EndPoint=pt_4)
divide = DivideCurve(Curve=ln, Count=2, Kinks=False)  # -> Points, Tangents, Parameters
item = ListItem(List=divide.Points, Index=1, Wrap=True)
pt_5 = Point(item)
pt_6 = ClusterOutput(pt_5)
