# Grasshopper definition Railway_190117_1.gh (Grasshopper 1.0.7)
# plug-ins: RailwayPlanner, ElkGHComponents

number_slider = Slider(6610000, range=0..10000000)
number_slider_2 = Slider(370000, range=0..1000000)
number_slider_3 = Slider(6650000, range=0..10000000)
number_slider_4 = Slider(340000, range=0..1000000)
panel = Panel("C:\Users\%USERNAME%\Documents\GitHub\GH_Files\nh_66_3.tif")
panel_2 = Panel("C:\Users\slense\VisualStudio2017\repos\GH_Files\nh_66_3.tif")
path = FilePath("C:\Users\slense\VisualStudio2017\repos\GH_Files\nh_66_3.tif")
dom = ConstructDomain(DomainStart=number_slider_4, DomainEnd=number_slider_2)
dom_2 = ConstructDomain(DomainStart=number_slider, DomainEnd=number_slider_3)
path_2 = FilePath("C:\Users\pihise\Documents\GitHub\GH_Files\nh_66_3.tif")
topo = Topography(FilePath=path_2, Longitude=dom, Latitude=dom_2)  # -> FileInfo, Points, Curves, Surface
pt = Point(topo.Points)
pdecon = Deconstruct(Point=pt)  # -> XComponent, YComponent, ZComponent
panel_3 = Panel(topo.FileInfo)
smaller = SmallerThan(FirstNumber=pdecon.ZComponent, SecondNumber=0)  # -> SmallerThan, OrEqualTo
cull = CullPattern(List=pt, CullPattern=invert(smaller.OrEqualTo))
pdecon_2 = Deconstruct(Point=cull)  # -> XComponent, YComponent, ZComponent
multiplication = Multiplication(A=pdecon_2.ZComponent, B=Slider(1, range=1..10))
pt_2 = ConstructPoint(XCoordinate=pdecon_2.XComponent, YCoordinate=pdecon_2.YComponent, ZCoordinate=multiplication)
pt_3 = Point(flatten(pt_2))

# ----
# Mesh
del = DelaunayMesh(Points=pt_3, Plane=PlaneXY(0, 0, 0))

mesh = Mesh(del)
bbox = BoundingBox(Content=mesh, Plane=PlaneXY(0, 0, 0))  # -> Box, Box_2
debox = DeconstructBox(Box=bbox.Box)  # -> Plane, X, Y, Z
subtraction = Subtraction(A=number_slider_2, B=number_slider_4)
subtraction_2 = Subtraction(A=number_slider_3, B=number_slider)
dedomain = DeconstructDomain(Domain=debox.X)  # -> Start, End
dedomain_2 = DeconstructDomain(Domain=debox.Y)  # -> Start, End
neg = Negative(Value=dedomain.Start)
num = Number(subtraction)
num_2 = Number(subtraction_2)
num_3 = Number(neg)
num_4 = Number(dedomain_2.End)
division = Division(A=num_2, B=num_4)
division_2 = Division(A=num, B=num_3)
scale_nu = ScaleNU(Geometry=mesh, Plane=PlaneXY(0, 0, 0), ScaleX=division_2, ScaleY=division, ScaleZ=1)  # -> Geometry, Transform
mirror = Mirror(Geometry=scale_nu.Geometry, Plane=PlaneYZ(0, 0, 0))  # -> Geometry, Transform
mesh_2 = Mesh(mirror.Geometry)
contour = Contour(Shape=mirror.Geometry, Point=Point(0, 0, 0), Direction=Vector(0, 0, 10), Distance=10)
crv = Curve(contour)
c_script = CSharpScript(G=crv, view="Top")  # -> out; inputs G: tree of Curve, view: String
# ---------- c_script: C# usings ----------
using System.IO;
using System.Linq;
using System.Data;
using System.Drawing;
using System.Reflection;
using System.Windows.Forms;
using System.Xml;
using System.Xml.Linq;
using System.Runtime.InteropServices;

using Rhino.DocObjects;
using Rhino.Collections;
using GH_IO;
using GH_IO.Serialization;
# ---------- c_script: C# ----------
    geometry = G;
    viewport = view;
# ---------- c_script: C# additional code ----------
  DataTree<Curve> geometry;
  String viewport;

  //Return a BoundingBox that contains all the geometry you are about to draw.
  public override BoundingBox ClippingBox
  {
    get
    {
      return BoundingBox.Empty;
    }
  }

  //Draw all meshes in this method.
  public override void DrawViewportMeshes(IGH_PreviewArgs args)
  {
    //Rhino.RhinoApp.WriteLine(args.Display.Viewport.Name);
    if(args.Display.Viewport.Name == viewport)
      foreach(GH_Path path in geometry.Paths)
        foreach(Curve b in geometry.Branch(path))
          args.Display.DrawCurve(b, System.Drawing.Color.CadetBlue);
  }

  //Draw all wires and points in this method.
  public override void DrawViewportWires(IGH_PreviewArgs args)
  {
  }
# ---------- end c_script ----------
vec = Vector(Vector(0, 0, 0))
genes = GenePool(
    Decimals=0,
    Maximum=50,
    Minimum=-50,
    Value=[0.8473466215, -0.09298732089, 0.1850474119, -0.0583103956, 0.1052291268, 0.07368930852, -0.279022873, 0.9205146487, 0.7020477772, 0.2944898742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])
genes_2 = GenePool(Decimals=0, Maximum=50, Minimum=-50, Value=[-5, -16, 31, 3, 12, 38, 8, 9, -25, -11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])
swatch = ColourSwatch(SwatchColor=RGB(138, 206, 81))
Z = UnitZ(Factor=genes_2)
galapagos = Galapagos(fitness=num_6, gene=genes_2)
Z_2 = UnitZ(Factor=1)
series = Series(Start=0, Step=Slider(0.0005, range=0..0.001), Count=Slider(2001, range=0..10000))
number_slider_5 = Slider(1, range=0..1)
Z_3 = UnitZ(Factor=Slider(5, range=0..10))
neg_2 = Negative(Value=Z_3)
neg_3 = Negative(Value=Slider(15, range=0..100))
neg_4 = Negative(Value=Slider(20, range=0..100))
number_slider_6 = Slider(123, range=0..123)
Z_4 = UnitZ(Factor=Slider(21, range=0..100))
Z_5 = UnitZ(Factor=Slider(34, range=0..100))
Z_6 = UnitZ(Factor=Slider(45, range=0..100))

panel_4 = Panel("Input curve")
crv_2 = Curve(<curve referenced from the Rhino model>)
Z_7 = UnitZ(Factor=Slider(3000, range=0..10000))
neg_5 = Negative(Value=Z_7)

curvature = Curvature(Curve=reparameterize(crv_2), Parameter=Slider(0.7053, range=0..1))  # -> P, K, C
darc = DeconstructArc(Arc=curvature.C)  # -> BasePlane, Radius, Angle
radiuscheck = CheckRailCurveRadius(Curve=crv_2)
panel_5 = Panel(darc.Radius)

extr = Extrude(Base=radiuscheck, Direction=neg_5)
mesh_uv = MeshSurface(Surface=extr, UCount=Slider(100, range=0..1000), VCount=Slider(500, range=0..1000), Overhang=True, Equalize=False)
mesh_3 = Mesh(mesh_uv)
mmx = MeshMesh(MeshA=mesh_2, MeshB=mesh_3, UseMeshMeshFast=True)
crv_3 = Curve(reparameterize(mmx))

# ----
# New Interpolated Crv
number_slider_7 = Slider(100, range=0..500)
crv_4 = Curve(reparameterize(crv_3))
divide = DivideCurve(Curve=crv_4, Count=number_slider_7, Kinks=False)  # -> Points, Tangents, Parameters
intcrv = Interpolate(Vertices=divide.Points, Degree=5, Periodic=False, KnotStyle=1)  # -> Curve, Length, Domain
crv_cp = CurveClosestPoint(Point=divide.Points, Curve=intcrv.Curve)  # -> Point, Parameter, Distance
pt_4 = Point(crv_cp.Point)

# ----
# Mean CRV/Polyline
pt_5 = Point(pt_4)
crv_5 = Curve(reparameterize(crv_3))
lng = ListLength(List=pt_5)
end = EndPoints(Curve=crv_5)  # -> Start, End
pdecon_3 = Deconstruct(Point=pt_5)  # -> XComponent, YComponent, ZComponent
pline = PolyLine(Vertices=pt_5, Closed=False)
series_2 = Series(Start=0, Step=1, Count=lng)
item = ListItem(List=series_2, Index=-1, Wrap=True)
pdecon_4 = Deconstruct(Point=end.End)  # -> XComponent, YComponent, ZComponent
pdecon_5 = Deconstruct(Point=end.Start)  # -> XComponent, YComponent, ZComponent
division_3 = Division(A=series_2, B=item)
subtraction_3 = Subtraction(A=pdecon_4.ZComponent, B=pdecon_5.ZComponent)
multiplication_2 = Multiplication(A=division_3, B=subtraction_3)
addition = Addition(A=pdecon_5.ZComponent, B=multiplication_2)
pt_6 = ConstructPoint(XCoordinate=pdecon_3.XComponent, YCoordinate=pdecon_3.YComponent, ZCoordinate=addition)
pline_2 = PolyLine(Vertices=pt_6, Closed=False)
crv_6 = Curve(pline_2)

crv_7 = Curve(crv_2)

# ----
# Radius
curvature_2 = Curvature(Curve=intcrv.Curve, Parameter=crv_cp.Parameter)  # -> P, K, C
darc_2 = DeconstructArc(Arc=curvature_2.C)  # -> BasePlane, Radius, Angle
sort = SortList(Keys=darc_2.Radius)  # -> Keys, ValuesA
panel_6 = Panel(sort.Keys)

# ----
# Inclination
pt_7 = Point(pt_4)
shift = ShiftList(List=pt_7, Shift=1, Wrap=False)
shift_2 = ShiftList(List=pt_7, Shift=-1, Wrap=False)
vec2pt = Vector2Pt(PointA=shift, PointB=shift_2, Unitize=False)  # -> Vector, Length
xy = XYPlane(Origin=Point(0, 0, 0))
project = Project(Geometry=vec2pt.Vector, Plane=xy)  # -> Geometry, Transform
angle = Angle(VectorA=project.Geometry, VectorB=vec2pt.Vector)  # -> Angle, Reflex
deg = Degrees(Radians=angle.Angle)
sort_2 = SortList(Keys=deg)  # -> Keys, ValuesA
panel_7 = Panel(sort_2.Keys)

c_script_2 = CSharpScript(G=crv_7, view="Top")  # -> out; inputs G: tree of Curve, view: String
# ---------- c_script_2: C# ----------
    geometry = G;
    viewport = view;
# ---------- c_script_2: C# additional code ----------
  DataTree<Curve> geometry;
  String viewport;

  //Return a BoundingBox that contains all the geometry you are about to draw.
  public override BoundingBox ClippingBox
  {
    get
    {
      return BoundingBox.Empty;
    }
  }

  //Draw all meshes in this method.
  public override void DrawViewportMeshes(IGH_PreviewArgs args)
  {
    
    //Rhino.RhinoApp.WriteLine(args.Display.Viewport.Name);
    if(args.Display.Viewport.Name == viewport)
      foreach(GH_Path path in geometry.Paths)
        foreach(Curve b in geometry.Branch(path))
          args.Display.DrawCurve(b, System.Drawing.Color.Black, 3);
  }

  //Draw all wires and points in this method.
  public override void DrawViewportWires(IGH_PreviewArgs args)
  {
  }
# ---------- end c_script_2 ----------

# ----
# Polyline
pt_8 = Point(crv_cp.Point)
pline_3 = PolyLine(Vertices=pt_8, Closed=False)
crv_8 = Curve(crv_4)

# ----
# Rotated PLine
crv_9 = Curve(crv_8)
explode = Explode(Curve=crv_9, Recursive=True)  # -> Segments, Vertices
xy_2 = XYPlane(Origin=Point(0, 0, 0))
yz = YZPlane(Origin=Point(0, 0, 0))
Y = UnitY(Factor=1)
angle_2 = Angle(VectorA=explode.Segments, VectorB=Y, Plane=xy_2)  # -> Angle, Reflex
end_2 = EndPoints(Curve=explode.Segments)  # -> Start, End
xy_3 = XYPlane(Origin=end_2.Start)
rotate = Rotate(Geometry=explode.Segments, Angle=angle_2.Angle, Plane=xy_3)  # -> Geometry, Transform
crv_10 = Curve(rotate.Geometry)

# ----
# Moved PLine
crv_11 = Curve(crv_10)
shift_3 = ShiftList(List=crv_11, Shift=1, Wrap=False)
crv_12 = Curve(crv_11)
end_3 = EndPoints(Curve=crv_12)  # -> Start, End
end_4 = EndPoints(Curve=shift_3)  # -> Start, End
vec2pt_2 = Vector2Pt(PointA=end_3.End, PointB=end_4.Start, Unitize=False)  # -> Vector, Length

cull_i = CullIndex(List=vec2pt_2.Vector, Indices=-1, Wrap=True)

ma = MassAddition(Input=cull_i)  # -> Result, PartialResults
vec_2 = Vector(flatten(ma.PartialResults))
vec_3 = Vector([vec, vec_2])
rev = Reverse(Vector=vec_3)
move = Move(Geometry=crv_11, Motion=rev)  # -> Geometry, Transform
crv_13 = Curve(move.Geometry)

# ----
# Dimensions
crv_14 = Curve(crv_13)
join = JoinCurves(Curves=crv_14, Preserve=False)
crv_15 = Curve(join)
end_5 = EndPoints(Curve=crv_14)  # -> Start, End
end_6 = EndPoints(Curve=crv_15)  # -> Start, End
pdecon_6 = Deconstruct(Point=end_6.Start)  # -> XComponent, YComponent, ZComponent
pdecon_7 = Deconstruct(Point=end_6.End)  # -> XComponent, YComponent, ZComponent
pt_9 = Point(flatten([end_5.Start, end_6.End]))
mid_on_curve = MidOnCurve(crv=crv_14)  # -> flatten(pt)
angle_3 = Angle(VectorA=Vector(0, 1, 0), VectorB=crv_14)  # -> Angle, Reflex
addition_2 = Addition(A=pdecon_6.ZComponent, B=Slider(5000, range=0..10000))
deg_2 = Degrees(Radians=angle_3.Angle)
pt_10 = ConstructPoint(XCoordinate=pdecon_6.XComponent, YCoordinate=pdecon_6.YComponent, ZCoordinate=addition_2)
pt_11 = ConstructPoint(XCoordinate=pdecon_7.XComponent, YCoordinate=pdecon_7.YComponent, ZCoordinate=addition_2)
linedim = LineDimension(Line=crv_14, Text="{0:0.00}", Size=10)
round = Round(number=deg_2, decimals=1)
ln = Line(StartPoint=pt_10, EndPoint=pt_11)
special_text = SpecialTextTag(tag=round, loc=mid_on_curve, siz=10)  # inputs tag: String, loc: Point3d, siz: Double
# ---------- special_text: C# ----------
    if (string.IsNullOrWhiteSpace(tag))
      return;

    _text.Add(tag);
    _point.Add(loc);
    _size.Add(siz);
# ---------- special_text: C# additional code ----------
  private readonly List<string> _text = new List<string>();
  private readonly List<Point3d> _point = new List<Point3d>();
  private readonly List<double> _size = new List<double>();

  public override void BeforeRunScript()
  {
    _text.Clear();
    _point.Clear();
    _size.Clear();
  }

  public override BoundingBox ClippingBox
  {
    get
    {
      return BoundingBox.Empty;
    }
  }
  public override void DrawViewportWires(IGH_PreviewArgs args)
  {
    if (_text.Count == 0)
      return;

    Plane plane;
    args.Viewport.GetFrustumFarPlane(out plane);

    for (int i = 0; i < _text.Count; i++)
    {
      string text = _text[i];
      double size = _size[i];
      Point3d point = _point[i];
      plane.Origin = point;

      // Figure out the size. This means measuring the visible size in the viewport AT the current location.
      double pixPerUnit;
      Rhino.Display.RhinoViewport viewport = args.Viewport;
      viewport.GetWorldToScreenScale(point, out pixPerUnit);

      size = size / pixPerUnit;

      Rhino.Display.Text3d drawText = new Rhino.Display.Text3d(text, plane, size);
      args.Display.Draw3dText(drawText, Color.Firebrick);
      drawText.Dispose();
    }
  }
# ---------- end special_text ----------
serialdim = SerialDimension(Line=ln, Points=pt_9, Text="{0:0.00}", Size=300)

# ----
# Create Interpolate curve and lets user adjust
number_slider_8 = Slider(27650, range=0..100000)
crv_16 = Curve(crv_13)
lng_2 = ListLength(List=crv_16)
division_4 = Division(A=lng_2, B=10)
int = Integer(division_4)
join_2 = JoinCurves(Curves=crv_16, Preserve=False)
divide_2 = DivideCurve(Curve=join_2, Count=Slider(250, range=0..1000), Kinks=False)  # -> Points, Tangents, Parameters
pdecon_8 = Deconstruct(Point=divide_2.Points)  # -> XComponent, YComponent, ZComponent
pt_12 = ConstructPoint(XCoordinate=pdecon_8.XComponent, YCoordinate=pdecon_8.YComponent, ZCoordinate=expr("x*10", pdecon_8.ZComponent))
crv_17 = Curve(join_2)
end_7 = EndPoints(Curve=crv_17)  # -> Start, End
ln_2 = Line(StartPoint=end_7.Start, EndPoint=end_7.End)
button = Button()

vec_4 = VectorXYZ(XComponent=0, YComponent=number_slider_8, ZComponent=expr("x/100", number_slider_8))  # -> Vector, Length

move_2 = Move(Geometry=pt_12, Motion=vec_4.Vector)  # -> Geometry, Transform
pline_4 = PolyLine(Vertices=move_2.Geometry, Closed=False)
profile_crv = Curve(pline_4)
cp = ControlPoints(Curve=profile_crv)  # -> Points, Weights, Knots
cull_2 = CullPattern(List=cp.Points, CullPattern=[True, False, False, False, False])
item_2 = ListItem(List=cp.Points, Index=-1, Wrap=True)
merge = Merge(Data1=flatten(cull_2), Data2=flatten(item_2))
crvadjust = AdjustCurve(Curve=profile_crv, Reset=button, Layername="Landscape Profile", Color=swatch, Locked=True)
topography_crv = Curve(crvadjust)
c_script_3 = CSharpScript(G=topography_crv, view="Right", swatch=swatch, thick=Slider(4, range=0..10))  # -> out; inputs G: tree of Curve, view: String, swatch: Color, thick: Int32
# ---------- c_script_3: C# ----------
    geometry = G;
    viewport = view;
    color = swatch;
    thickness = thick;
# ---------- c_script_3: C# additional code ----------
  DataTree<Curve> geometry;
  String viewport;

  //Return a BoundingBox that contains all the geometry you are about to draw.
  public override BoundingBox ClippingBox
  {
    get
    {
      return BoundingBox.Empty;
    }
  }

  //Draw all meshes in this method.
  public override void DrawViewportMeshes(IGH_PreviewArgs args)
  {

    //Rhino.RhinoApp.WriteLine(args.Display.Viewport.Name);
    if(args.Display.Viewport.Name == viewport)
      foreach(GH_Path path in geometry.Paths)
        foreach(Curve b in geometry.Branch(path))
          args.Display.DrawCurve(b, color, thickness);
  }

  //Draw all wires and points in this method.
  public override void DrawViewportWires(IGH_PreviewArgs args)
  {
  }

  private System.Drawing.Color color = System.Drawing.Color.IndianRed;
  private int thickness = 3;
# ---------- end c_script_3 ----------

cullpt = CullDuplicates(Points=merge, Tolerance=0.1, CullMode=3)  # -> Points, Indices, Valence
profile_crv_2 = Curve(reparameterize(topography_crv))
eval = EvaluateCurve(Curve=profile_crv_2, Parameter=series)  # -> Point, Tangent, Angle
xz = XZPlane(Origin=eval.Point)
topography_crv_2 = Curve(topography_crv)

pline_5 = PolyLine(Vertices=cullpt.Points, Closed=False)
smoothpline = SmoothPolyline(Polyline=pline_5, Strength=1, Times=Slider(2, range=1..4))
crv_18 = Curve(smoothpline)

cp_2 = ControlPoints(Curve=crv_18)  # -> Points, Weights, Knots
cull_i_2 = CullIndex(List=cp_2.Points, Indices=0, Wrap=True)
cull_i_3 = CullIndex(List=cull_i_2, Indices=-1, Wrap=True)
pt_13 = Point(cull_i_3)
move_3 = Move(Geometry=pt_13, Motion=Z)  # -> Geometry, Transform
end_8 = EndPoints(Curve=crv_18)  # -> Start, End
merge_2 = Merge(Data1=flatten(end_8.Start), Data2=flatten(move_3.Geometry), Data3=flatten(end_8.End))
pline_6 = PolyLine(Vertices=merge_2, Closed=False)

crvadjust_2 = AdjustCurve(Curve=pline_6, Reset=button, Layername="Rail Profile", Color=ColourSwatch(SwatchColor=RGB(217, 130, 152)), Locked=False)
profile_crv_3 = Curve(crvadjust_2)

inclinationcheck = CheckRailCurveInclination(Curve=profile_crv_3, CurveScale=10)
rail_crv = Curve(reparameterize(profile_crv_3))
pcx = CurvePlane(Curve=rail_crv, Plane=xz)  # -> flatten(Points), ParamsC, ParamsP
xz_2 = XZPlane(Origin=pcx.Points)
pcx_2 = CurvePlane(Curve=profile_crv_2, Plane=xz_2)  # -> flatten(Points), ParamsC, ParamsP
vec2pt_3 = Vector2Pt(PointA=pcx.Points, PointB=pcx_2.Points, Unitize=False)  # -> Vector, Length
item_3 = ListItem(List=pcx.Points, Index=Slider(1923, range=0..10000), Wrap=True)
pdecon_9 = Deconstruct(Point=vec2pt_3.Vector)  # -> XComponent, YComponent, ZComponent
lng_3 = ListLength(List=pcx.Points)
num_5 = Number(expr("(x*-1)/10", pdecon_9.ZComponent))
round_2 = Round(Number=pdecon_9.ZComponent)  # -> Nearest, Floor, Ceiling
hi = HeightIdentifier(ZValue=expr("x/10", round_2.Ceiling))  # -> Low, Mid, High, Cut, Tunnel
c_script_4 = CSharpScript(x=hi.Low, y=lng_3)  # -> out, A; inputs x: list of Int32, y: Int32
# ---------- c_script_4: C# ----------
    List<List<int>> groupedPts = new List<List<int>>();
    DataTree<int> boolTree = new DataTree<int>();
    List<int> tempList = new List<int>();
    for (int i = 1; i < x.Count; i++)
    {
      if ((x[i] - x[i - 1]) == 1 && i != x.Count - 1)
        tempList.Add(x[i - 1]);
      else if ((x[i] - x[i - 1]) == 1 && i == x.Count - 1)
      {
        tempList.Add(x[i - 1]);
        tempList.Add(x[i]);
        if (x[i] + 1 <= y-1 )
        tempList.Add(x[i] + 1);
      }
      else
      {
        tempList.Add(x[i - 1]);
        tempList.Add(x[i - 1] + 1);
        groupedPts.Add(tempList);
        tempList = new List<int>();
      }
    }

    groupedPts.Add(tempList);
    int pathId = 0;

    foreach (List<int> list in groupedPts)
    {
      GH_Path pth = new GH_Path(pathId);
      foreach (int index in list)
      {
        boolTree.Add(index, pth);
      }

      pathId++;
    }

    A = boolTree;
# ---------- end c_script_4 ----------
c_script_5 = CSharpScript(x=hi.Mid, y=lng_3)  # -> out, A; inputs x: list of Int32, y: Int32; same code as c_script_4
c_script_6 = CSharpScript(x=hi.High, y=lng_3)  # -> out, A; inputs x: list of Int32, y: Int32; same code as c_script_4
c_script_7 = CSharpScript(x=hi.Cut, y=lng_3)  # -> out, A; inputs x: list of Int32, y: Int32; same code as c_script_4
c_script_8 = CSharpScript(x=hi.Tunnel, y=lng_3)  # -> out, A; inputs x: list of Int32, y: Int32; same code as c_script_4
item_4 = ListItem(List=pcx.Points, Index=c_script_4.A, Wrap=True)
item_5 = ListItem(List=num_5, Index=c_script_4.A, Wrap=True)
item_6 = ListItem(List=pcx.Points, Index=c_script_5.A, Wrap=True)
item_7 = ListItem(List=num_5, Index=c_script_6.A, Wrap=True)
item_8 = ListItem(List=num_5, Index=c_script_7.A, Wrap=True)
item_9 = ListItem(List=num_5, Index=c_script_5.A, Wrap=True)
avr = Average(Input=item_5)  # -> flatten(ArithmeticMean)
item_10 = ListItem(List=pcx.Points, Index=c_script_6.A, Wrap=True)
item_11 = ListItem(List=num_5, Index=c_script_8.A, Wrap=True)
item_12 = ListItem(List=pcx.Points, Index=c_script_7.A, Wrap=True)
avr_2 = Average(Input=item_7)  # -> flatten(ArithmeticMean)
intcrv_2 = Interpolate(Vertices=item_4, Degree=3, Periodic=False, KnotStyle=1)  # -> flatten(Curve), Length, Domain
avr_3 = Average(Input=item_8)  # -> flatten(ArithmeticMean)
item_13 = ListItem(List=pcx.Points, Index=c_script_8.A, Wrap=True)
avr_4 = Average(Input=item_9)  # -> flatten(ArithmeticMean)
intcrv_3 = Interpolate(Vertices=item_6, Degree=3, Periodic=False, KnotStyle=1)  # -> flatten(Curve), Length, Domain
avr_5 = Average(Input=item_11)  # -> flatten(ArithmeticMean)
intcrv_4 = Interpolate(Vertices=item_10, Degree=3, Periodic=False, KnotStyle=1)  # -> flatten(Curve), Length, Domain
intcrv_5 = Interpolate(Vertices=item_12, Degree=3, Periodic=False, KnotStyle=1)  # -> flatten(Curve), Length, Domain
intcrv_6 = Interpolate(Vertices=item_13, Degree=3, Periodic=False, KnotStyle=1)  # -> flatten(Curve), Length, Domain
panel_8 = Panel(avr)
move_4 = Move(Geometry=intcrv_3.Curve, Motion=Z_3)  # -> Geometry, Transform
move_5 = Move(Geometry=intcrv_3.Curve, Motion=neg_2)  # -> Geometry, Transform
move_6 = Move(Geometry=intcrv_4.Curve, Motion=Z_3)  # -> Geometry, Transform
move_7 = Move(Geometry=intcrv_4.Curve, Motion=neg_2)  # -> Geometry, Transform
move_8 = Move(Geometry=intcrv_5.Curve, Motion=Z_3)  # -> Geometry, Transform
move_9 = Move(Geometry=intcrv_5.Curve, Motion=neg_2)  # -> Geometry, Transform
move_10 = Move(Geometry=intcrv_6.Curve, Motion=Z_3)  # -> Geometry, Transform
move_11 = Move(Geometry=intcrv_6.Curve, Motion=neg_2)  # -> Geometry, Transform
move_12 = Move(Geometry=intcrv_2.Curve, Motion=Z_3)  # -> Geometry, Transform
move_13 = Move(Geometry=intcrv_2.Curve, Motion=neg_2)  # -> Geometry, Transform
entwine = Entwine(Branch00=move_4.Geometry, Branch01=move_5.Geometry, FlattenInputs=True)
entwine_2 = Entwine(Branch00=move_6.Geometry, Branch01=move_7.Geometry, FlattenInputs=True)
entwine_3 = Entwine(Branch00=move_8.Geometry, Branch01=move_9.Geometry, FlattenInputs=True)
entwine_4 = Entwine(Branch00=move_10.Geometry, Branch01=move_11.Geometry, FlattenInputs=True)
entwine_5 = Entwine(Branch00=move_12.Geometry, Branch01=move_13.Geometry, FlattenInputs=True)
flip = FlipMatrix(Data=entwine)
flip_2 = FlipMatrix(Data=entwine_2)
flip_3 = FlipMatrix(Data=entwine_3)
flip_4 = FlipMatrix(Data=entwine_5)
flip_5 = FlipMatrix(Data=entwine_4)
loft = Loft(Curves=flip, Options={Adjust=False, Closed=False, LoftEnds=0, LoftSimp=0, LoftType=0, Rebuild=10, Refit=0.01})  # -> flatten(Loft)
loft_2 = Loft(Curves=flip_2, Options={Adjust=False, Closed=False, LoftEnds=0, LoftSimp=0, LoftType=0, Rebuild=10, Refit=0.01})  # -> flatten(Loft)
loft_3 = Loft(Curves=flip_3, Options={Adjust=False, Closed=False, LoftEnds=0, LoftSimp=0, LoftType=0, Rebuild=10, Refit=0.01})  # -> flatten(Loft)
loft_4 = Loft(Curves=flip_4, Options={Adjust=False, Closed=False, LoftEnds=0, LoftSimp=0, LoftType=0, Rebuild=10, Refit=0.01})  # -> flatten(Loft)
loft_5 = Loft(Curves=flip_5, Options={Adjust=False, Closed=False, LoftEnds=0, LoftSimp=0, LoftType=0, Rebuild=10, Refit=0.01})  # -> flatten(Loft)
preview = CustomPreview(Geometry=loft, Material=ColourSwatch(SwatchColor=RGB(232, 252, 101)))
preview_2 = CustomPreview(Geometry=loft_4, Material=ColourSwatch(SwatchColor=RGB(81, 240, 142)))
merge_3 = Merge(Data1=intcrv_2.Curve, Data2=intcrv_3.Curve, Data3=intcrv_4.Curve)  # -> flatten(Result)
preview_3 = CustomPreview(Geometry=loft_2, Material=ColourSwatch(SwatchColor=RGB(255, 97, 97)))
preview_4 = CustomPreview(Geometry=loft_3, Material=ColourSwatch(SwatchColor=RGB(156, 120, 50)))
preview_5 = CustomPreview(Geometry=loft_5, Material=ColourSwatch(SwatchColor=RGB(0, 0, 0)))
simplify = SimplifyCurve(Curve=merge_3)  # -> Curve, Simplified
crv_19 = Curve(simplify.Curve)
cr = CreateRoad(SegmentCrv=intcrv_2.Curve, Height=avr)
cr_2 = CreateRoad(SegmentCrv=intcrv_3.Curve, Height=avr_4)
cr_3 = CreateRoad(SegmentCrv=intcrv_4.Curve, Height=avr_2)
cr_4 = CreateRoad(SegmentCrv=intcrv_5.Curve, Height=avr_3)
cr_5 = CreateRoad(SegmentCrv=intcrv_6.Curve, Height=avr_5)
merge_4 = Merge(Data1=cr, Data2=cr_2, Data3=cr_3, Data4=cr_4, Data5=cr_5)
rclassifier = RailClassifier(Road=merge_4)  # -> SegmentCurve, simplify(RoadTypes)
flip_6 = FlipMatrix(Data=rclassifier.RoadTypes)
curvepoint = PointOnCurve(rclassifier.SegmentCurve, parameter=0.5)
segments = Curve(rclassifier.SegmentCurve)
branch = TreeBranch(Tree=flip_6, Path=Slider(1, range=0..100), MaintainPaths=True)
branch_2 = TreeBranch(Tree=flip_6, Path=Slider(0, range=0..100), MaintainPaths=True)
type = Text(flatten(branch_2))
item_14 = ListItem(List=rclassifier.SegmentCurve, Index=number_slider_6, Wrap=True)
item_15 = ListItem(List=branch_2, Index=number_slider_6, Wrap=True)
move_14 = Move(Geometry=curvepoint, Motion=Z_4)  # -> Geometry, Transform
move_15 = Move(Geometry=curvepoint, Motion=Z_5)  # -> Geometry, Transform
tag = TextTag(Location=move_14.Geometry, Text=branch_2)
panel_9 = Panel(item_15)
tag_2 = TextTag(Location=move_15.Geometry, Text=branch)
price_calculator = CSharpScript(
    roadType=branch_2,
    bankLow="10000",
    bankHigh="15000",
    bridgeLow="50000",
    bridgeHigh="75000",
    cut="60000",
    tunnel="120000")  # -> out, A; inputs roadType: String, bankLow: Double, bankHigh: Double, bridgeLow: Double, bridgeHigh: Double, cut: Double, tunnel: Double
# ---------- price_calculator: C# ----------
    double price = 0;

    if (roadType == "Bank Low")
      price = bankLow;

    if (roadType == "Bank High")
      price = bankHigh;

    if (roadType == "Bridge Low")
      price = bridgeLow;

    if (roadType == "Bridge High")
      price = bridgeHigh;

    if (roadType == "Cut")
      price = cut;

    if (roadType == "Tunnel")
      price = tunnel;

    A = price;
# ---------- end price_calculator ----------
end_9 = EndPoints(Curve=rclassifier.SegmentCurve)  # -> Start, End
pdecon_10 = Deconstruct(Point=end_9.Start)  # -> XComponent, YComponent, expr("x/10", ZComponent)
pdecon_11 = Deconstruct(Point=end_9.End)  # -> XComponent, YComponent, expr("x/10", ZComponent)
pt_14 = ConstructPoint(XCoordinate=pdecon_11.XComponent, YCoordinate=pdecon_11.YComponent, ZCoordinate=pdecon_11.ZComponent)
pt_15 = ConstructPoint(XCoordinate=pdecon_10.XComponent, YCoordinate=pdecon_10.YComponent, ZCoordinate=pdecon_10.ZComponent)
ln_3 = Line(StartPoint=pt_15, EndPoint=pt_14)
len = Length(Curve=ln_3)
multiplication_3 = Multiplication(A=len, B=price_calculator.A)
ma_2 = MassAddition(Input=multiplication_3)  # -> Result, PartialResults
division_5 = Division(A=ma_2.Result, B=Slider(1000000, range=0..1000000))
num_6 = Number(division_5)
round_3 = Round(Number=division_5)  # -> Nearest, Floor, Ceiling
join_3 = TextJoin(Text=[round_3.Ceiling, "        Mkr"])
panel_10 = Panel(join_3)

# ----
# Bank Low
c_script_9 = CSharpScript(x=type)  # -> out, A; inputs x: String
# ---------- c_script_9: C# ----------
    if(x == "Bank Low")
    {
      A = true;
    }
    else
    {
      A = false;
    }
# ---------- end c_script_9 ----------
cull_3 = CullPattern(List=segments, CullPattern=c_script_9.A)
segments_2 = Curve(cull_3)
topography_crv_3 = Curve(topography_crv_2)
end_10 = EndPoints(Curve=segments_2)  # -> Start, End
xz_3 = XZPlane(Origin=end_10.End)
xz_4 = XZPlane(Origin=end_10.Start)
pcx_3 = CurvePlane(Curve=topography_crv_3, Plane=xz_4)  # -> flatten(Points), flatten(ParamsC), ParamsP
pcx_4 = CurvePlane(Curve=topography_crv_3, Plane=xz_3)  # -> flatten(Points), flatten(ParamsC), ParamsP
num_7 = Number(graft(pcx_3.ParamsC))
num_8 = Number(graft(pcx_4.ParamsC))
num_9 = Number([num_7, num_8])
shatter = Shatter(Curve=topography_crv_3, Parameters=num_9)
ln_4 = Line(StartPoint=end_10.Start, EndPoint=pcx_3.Points)
ln_5 = Line(StartPoint=end_10.End, EndPoint=pcx_4.Points)
connecting_curves_sp = Curve(simplify(graft(ln_4)))
connecting_curves_ep = Curve(simplify(graft(ln_5)))
segments_3 = Curve(simplify(graft(segments_2)))

cluster = Cluster(D=shatter)

# ----
# Bridge
c_script_10 = CSharpScript(x=type)  # -> out, A; inputs x: String
# ---------- c_script_10: C# ----------
    if(x == "Bridge Low" || x == "Bridge High")
    {
      A = true;
    }
    else
    {
      A = false;
    }
# ---------- end c_script_10 ----------
cull_4 = CullPattern(List=segments, CullPattern=c_script_10.A)
topography_crv_4 = Curve(topography_crv_2)
segments_4 = Curve(cull_4)
end_11 = EndPoints(Curve=segments_4)  # -> Start, End
xz_5 = XZPlane(Origin=end_11.End)
xz_6 = XZPlane(Origin=end_11.Start)
pcx_5 = CurvePlane(Curve=topography_crv_4, Plane=xz_6)  # -> flatten(Points), flatten(ParamsC), ParamsP
pcx_6 = CurvePlane(Curve=topography_crv_4, Plane=xz_5)  # -> flatten(Points), flatten(ParamsC), ParamsP
num_10 = Number(graft(pcx_5.ParamsC))
num_11 = Number(graft(pcx_6.ParamsC))
num_12 = Number([num_10, num_11])
shatter_2 = Shatter(Curve=topography_crv_4, Parameters=num_12)
segments_5 = Curve(simplify(graft(segments_4)))
len_2 = Length(Curve=segments_5)
division_6 = Division(A=len_2, B=Slider(63, range=0..100))
int_2 = Integer(division_6)
divide_3 = DivideCurve(Curve=segments_5, Count=int_2, Kinks=False)  # -> Points, Tangents, Parameters
xz_7 = XZPlane(Origin=divide_3.Points)
pt_16 = Point(divide_3.Points)

cluster_2 = Cluster(D=shatter_2)

item_16 = ListItem(List=shatter_2, Index=cluster_2, Wrap=True)
topography_segments = Curve(simplify(graft(item_16)))
pcx_7 = CurvePlane(Curve=topography_segments, Plane=xz_7)  # -> Points, flatten(ParamsC), ParamsP
trim = TrimTree(Tree=pcx_7.Points, Depth=1)
pt_17 = Point(trim)
ln_6 = Line(StartPoint=pt_17, EndPoint=pt_16)
c_script_11 = CSharpScript(G=ln_6, view="Right", swatch=ColourSwatch(SwatchColor=RGB(99, 142, 199)), thick=Slider(3, range=0..10))  # -> out; inputs G: tree of Curve, view: String, swatch: Color, thick: Int32; same code as c_script_3

# ----
# Bank High
c_script_12 = CSharpScript(x=type)  # -> out, A; inputs x: String
# ---------- c_script_12: C# ----------
    if(x == "Bank High")
    {
      A = true;
    }
    else
    {
      A = false;
    }
# ---------- end c_script_12 ----------
cull_5 = CullPattern(List=segments, CullPattern=c_script_12.A)
segments_6 = Curve(cull_5)
topography_crv_5 = Curve(topography_crv_2)
end_12 = EndPoints(Curve=segments_6)  # -> Start, End
xz_8 = XZPlane(Origin=end_12.End)
xz_9 = XZPlane(Origin=end_12.Start)
pcx_8 = CurvePlane(Curve=topography_crv_5, Plane=xz_9)  # -> flatten(Points), flatten(ParamsC), ParamsP
pcx_9 = CurvePlane(Curve=topography_crv_5, Plane=xz_8)  # -> flatten(Points), flatten(ParamsC), ParamsP
num_13 = Number(graft(pcx_8.ParamsC))
num_14 = Number(graft(pcx_9.ParamsC))
num_15 = Number([num_13, num_14])
shatter_3 = Shatter(Curve=topography_crv_5, Parameters=num_15)
ln_7 = Line(StartPoint=end_12.Start, EndPoint=pcx_8.Points)
ln_8 = Line(StartPoint=end_12.End, EndPoint=pcx_9.Points)
connecting_curves_sp_2 = Curve(simplify(graft(ln_7)))
connecting_curves_ep_2 = Curve(simplify(graft(ln_8)))
segments_7 = Curve(simplify(graft(segments_6)))

cluster_3 = Cluster(D=shatter_3)

item_17 = ListItem(List=shatter_3, Index=cluster_3, Wrap=True)
topography_segments_2 = Curve(simplify(graft(item_17)))
crv_20 = Curve([topography_segments_2, segments_7, connecting_curves_sp_2, connecting_curves_ep_2])
join_4 = JoinCurves(Curves=crv_20, Preserve=False)  # -> simplify(Curves)
crv_21 = Curve(flatten(join_4))
cls = Closed(Curve=crv_21)  # -> Closed, Periodic
boundary = BoundarySurfaces(Edges=crv_21)
preview_6 = CustomPreview(Geometry=boundary, Material=ColourSwatch(SwatchColor=RGB(109, 109, 109)))

# ----
# Cut
c_script_13 = CSharpScript(x=type)  # -> out, A; inputs x: String
# ---------- c_script_13: C# ----------
    if(x == "Cut")
    {
      A = true;
    }
    else
    {
      A = false;
    }
# ---------- end c_script_13 ----------
cull_6 = CullPattern(List=segments, CullPattern=c_script_13.A)
topography_crv_6 = Curve(topography_crv_2)
segments_8 = Curve(cull_6)
end_13 = EndPoints(Curve=segments_8)  # -> Start, End
xz_10 = XZPlane(Origin=end_13.End)
xz_11 = XZPlane(Origin=end_13.Start)
pcx_10 = CurvePlane(Curve=topography_crv_6, Plane=xz_10)  # -> flatten(Points), flatten(ParamsC), ParamsP
pcx_11 = CurvePlane(Curve=topography_crv_6, Plane=xz_11)  # -> flatten(Points), flatten(ParamsC), ParamsP
num_16 = Number(graft(pcx_11.ParamsC))
num_17 = Number(graft(pcx_10.ParamsC))
num_18 = Number([num_16, num_17])
shatter_4 = Shatter(Curve=topography_crv_6, Parameters=num_18)
segments_9 = Curve(simplify(graft(segments_8)))
len_3 = Length(Curve=segments_9)
division_7 = Division(A=len_3, B=Slider(30, range=0..100))
int_3 = Integer(division_7)
divide_4 = DivideCurve(Curve=segments_9, Count=int_3, Kinks=False)  # -> Points, Tangents, Parameters

cluster_4 = Cluster(D=shatter_4)

# ----
# Tunnel
c_script_14 = CSharpScript(x=type)  # -> out, A; inputs x: String
# ---------- c_script_14: C# ----------
    if(x == "Tunnel")
    {
      A = true;
    }
    else
    {
      A = false;
    }
# ---------- end c_script_14 ----------
cull_7 = CullPattern(List=segments, CullPattern=c_script_14.A)
segments_10 = Curve(cull_7)

move_16 = Move(Geometry=segments_10, Motion=Z_6)  # -> Geometry, Transform
end_14 = EndPoints(Curve=segments_10)  # -> Start, End
end_15 = EndPoints(Curve=move_16.Geometry)  # -> Start, End
ln_9 = Line(StartPoint=end_14.End, EndPoint=end_15.End)
ln_10 = Line(StartPoint=end_14.Start, EndPoint=end_15.Start)
top = Curve(simplify(graft(move_16.Geometry)))
right = Curve(simplify(graft(ln_9)))
bottom = Curve(simplify(graft(segments_10)))
left = Curve(simplify(graft(ln_10)))
merge_5 = Merge(Data1=bottom, Data2=top, Data3=left, Data4=right)
crv_22 = Curve(merge_5)
join_5 = JoinCurves(Curves=crv_22, Preserve=False)
crv_23 = Curve(join_5)
boundary_2 = BoundarySurfaces(Edges=crv_23)

c_script_15 = CSharpScript(G=boundary_2, view="Right", swatch=ColourSwatch(SwatchColor=RGB(0, 0, 0)), thick=Slider(3, range=0..10))  # -> out; inputs G: tree of Curve, view: String, swatch: Color, thick: Int32; same code as c_script_3
preview_7 = CustomPreview(Geometry=boundary_2, Material=ColourSwatch(SwatchColor=RGB(109, 109, 109)))

item_18 = ListItem(List=simplify(shatter), Index=cluster, Wrap=True)
topography_segments_3 = Curve(simplify(graft(item_18)))
crv_24 = Curve([topography_segments_3, segments_3, connecting_curves_sp, connecting_curves_ep])
join_6 = JoinCurves(Curves=crv_24, Preserve=False)  # -> simplify(Curves)
crv_25 = Curve(flatten(join_6))
cls_2 = Closed(Curve=crv_25)  # -> Closed, Periodic

entwine_6 = Entwine(Branch00=topography_segments_3, Branch01=segments_3, FlattenInputs=True)
flip_7 = FlipMatrix(Data=entwine_6)
loft_6 = Loft(Curves=flip_7, Options={Adjust=False, Closed=False, LoftEnds=0, LoftSimp=0, LoftType=0, Rebuild=10, Refit=0.01})  # -> flatten(Loft)
mesh_4 = Mesh(loft_6)

preview_8 = CustomPreview(Geometry=mesh_4, Material=ColourSwatch(SwatchColor=RGB(133, 133, 133)))

item_19 = ListItem(List=shatter_4, Index=cluster_4, Wrap=True)
topography_segments_4 = Curve(simplify(graft(item_19)))

crv_cp_2 = CurveClosestPoint(Point=divide_4.Points, Curve=topography_segments_4)  # -> Point, Parameter, Distance
ln_11 = Line(StartPoint=divide_4.Points, EndPoint=crv_cp_2.Point)

c_script_16 = CSharpScript(G=ln_11, view="Right", swatch=ColourSwatch(SwatchColor=RGB(199, 192, 99)), thick=Slider(1, range=0..10))  # -> out; inputs G: tree of Curve, view: String, swatch: Color, thick: Int32; same code as c_script_3

# ==== cluster MidOnCurve: Parameter mid on a curve object
crv = ClusterInput()
crv_2 = Curve(crv)
end = EndPoints(Curve=crv_2)  # -> Start, End
mid2pts = MidBetweenTwoPoints(pt=end.Start, pt_2=end.End)
pt = ClusterOutput(mid2pts)

# ==== cluster Round: Rounds Value with number of decimals
number = ClusterInput()  # Number to round
decimals = ClusterInput()  # Number of decimals
_10º = PowerOf10(Value=decimals)
multiplication = Multiplication(A=number, B=_10º)
int = Integer(multiplication)
division = Division(A=int, B=_10º)
nearest = ClusterOutput(division)  # Nearest Value

# ==== cluster Cluster
D = ClusterInput()
flip = FlipMatrix(Data=D)
number_slider = Slider(1, range=0..1)
branch = TreeBranch(Tree=simplify(flip), Path=Slider(1, range=0..1), MaintainPaths=True)
neg = Negative(Value=Slider(2, range=0..10))
lng = ListLength(List=branch)
dup = DuplicateData(Data=neg, Number=expr("x-1", lng), Order=True)
merge = Merge(Data1=flatten(dup), Data2=Slider(1, range=0..10))  # -> simplify(graft(Result))
R = ClusterOutput(merge)

# ==== cluster MidBetweenTwoPoints: Get the midpoint between two points
pt = ClusterInput()
pt_2 = ClusterInput()
pt_3 = Point(pt)
pt_4 = Point(pt_2)
ln = Line(StartPoint=pt_3, EndPoint=pt_4)
divide = DivideCurve(Curve=ln, Count=2, Kinks=False)  # -> Points, Tangents, Parameters
item = ListItem(List=divide.Points, Index=1, Wrap=True)
pt_5 = Point(item)
pt_6 = ClusterOutput(pt_5)
