# Grasshopper definition elktest_PH.gh (Grasshopper 1.0.7)
# plug-ins: RailwayPlanner, ElkGHComponents

dom = ConstructDomain(DomainStart=Slider(46.5, range=0..100), DomainEnd=Slider(47.0004, range=0..100))
dom_2 = ConstructDomain(DomainStart=Slider(10.5, range=0..100), DomainEnd=Slider(11, range=0..100))
path = FilePath("U:\Railway\n46_e010_3arc_v2 (1).tif")
path_2 = FilePath("C:\Users\pihise\Downloads\n46_e010_3arc_v2.tif")
topo = Topography(FilePath=path, Longitude=dom_2, Latitude=dom)  # -> FileInfo, Points, Curves, Surface
panel = Panel(topo.FileInfo)
pt = Point(topo.Points)
pdecon = Deconstruct(Point=pt)  # -> XComponent, YComponent, ZComponent
smaller = SmallerThan(FirstNumber=pdecon.ZComponent, SecondNumber=0)  # -> SmallerThan, OrEqualTo
cull = CullPattern(List=pt, CullPattern=invert(smaller.OrEqualTo))
pt_2 = Point(flatten(cull))

# ----
# Mesh
del = DelaunayMesh(Points=pt_2, Plane=PlaneXY(0, 0, 0))
mesh = Mesh(del)

panel_2 = Panel("Input curve")
crv = Curve(<curve referenced from the Rhino model>)
extr = Extrude(Base=crv, Direction=Vector(0, 0, 4000))
mesh_uv = MeshSurface(Surface=extr, UCount=Slider(100, range=0..1000), VCount=Slider(500, range=0..1000), Overhang=True, Equalize=False)
mesh_2 = Mesh(mesh_uv)
mmx = MeshMesh(MeshA=mesh, MeshB=mesh_2, UseMeshMeshFast=True)
crv_2 = Curve(reparameterize(mmx))

# ----
# New Interpolated Crv
number_slider = Slider(50, range=0..500)
crv_3 = Curve(reparameterize(crv_2))
divide = DivideCurve(Curve=crv_3, Count=number_slider, Kinks=False)  # -> Points, Tangents, Parameters
intcrv = Interpolate(Vertices=divide.Points, Degree=3, Periodic=False, KnotStyle=1)  # -> Curve, Length, Domain
crv_cp = CurveClosestPoint(Point=divide.Points, Curve=intcrv.Curve)  # -> Point, Parameter, Distance
pt_3 = Point(crv_cp.Point)

# ----
# Mean CRV/Polyline
pt_4 = Point(pt_3)
crv_4 = Curve(reparameterize(crv_2))
lng = ListLength(List=pt_4)
end = EndPoints(Curve=crv_4)  # -> Start, End
pdecon_2 = Deconstruct(Point=pt_4)  # -> XComponent, YComponent, ZComponent
pline = PolyLine(Vertices=pt_4, Closed=False)
series = Series(Start=0, Step=1, Count=lng)
item = ListItem(List=series, Index=-1, Wrap=True)
pdecon_3 = Deconstruct(Point=end.End)  # -> XComponent, YComponent, ZComponent
pdecon_4 = Deconstruct(Point=end.Start)  # -> XComponent, YComponent, ZComponent
division = Division(A=series, B=item)
subtraction = Subtraction(A=pdecon_3.ZComponent, B=pdecon_4.ZComponent)
multiplication = Multiplication(A=division, B=subtraction)
addition = Addition(A=pdecon_4.ZComponent, B=multiplication)
pt_5 = ConstructPoint(XCoordinate=pdecon_2.XComponent, YCoordinate=pdecon_2.YComponent, ZCoordinate=addition)
pline_2 = PolyLine(Vertices=pt_5, Closed=False)
crv_5 = Curve(pline_2)

# ----
# Radius
curvature = Curvature(Curve=intcrv.Curve, Parameter=crv_cp.Parameter)  # -> P, K, C
darc = DeconstructArc(Arc=curvature.C)  # -> BasePlane, Radius, Angle
sort = SortList(Keys=darc.Radius)  # -> Keys, ValuesA
panel_3 = Panel(sort.Keys)

# ----
# Inclination
pt_6 = Point(pt_3)
shift = ShiftList(List=pt_6, Shift=1, Wrap=False)
shift_2 = ShiftList(List=pt_6, Shift=-1, Wrap=False)
vec2pt = Vector2Pt(PointA=shift, PointB=shift_2, Unitize=False)  # -> Vector, Length
xy = XYPlane(Origin=Point(0, 0, 0))
project = Project(Geometry=vec2pt.Vector, Plane=xy)  # -> Geometry, Transform
angle = Angle(VectorA=project.Geometry, VectorB=vec2pt.Vector)  # -> Angle, Reflex
deg = Degrees(Radians=angle.Angle)
sort_2 = SortList(Keys=deg)  # -> Keys, ValuesA
panel_4 = Panel(sort_2.Keys)

# ----
# Polyline
pt_7 = Point(crv_cp.Point)
pline_3 = PolyLine(Vertices=pt_7, Closed=False)
crv_6 = Curve(pline_3)

# ----
# Rotated PLine
crv_7 = Curve(crv_6)
explode = Explode(Curve=crv_7, Recursive=True)  # -> Segments, Vertices
xy_2 = XYPlane(Origin=Point(0, 0, 0))
yz = YZPlane(Origin=Point(0, 0, 0))
Y = UnitY(Factor=1)
angle_2 = Angle(VectorA=explode.Segments, VectorB=Y, Plane=xy_2)  # -> Angle, Reflex
end_2 = EndPoints(Curve=explode.Segments)  # -> Start, End
xy_3 = XYPlane(Origin=end_2.Start)
rotate = Rotate(Geometry=explode.Segments, Angle=angle_2.Angle, Plane=xy_3)  # -> Geometry, Transform
crv_8 = Curve(rotate.Geometry)

vec = Vector(Vector(0, 0, 0))
c_script = CSharpScript()  # -> Out, A

# ----
# Moved PLine
crv_9 = Curve(crv_8)
shift_3 = ShiftList(List=crv_9, Shift=1, Wrap=False)
crv_10 = Curve(crv_9)
end_3 = EndPoints(Curve=crv_10)  # -> Start, End
end_4 = EndPoints(Curve=shift_3)  # -> Start, End
vec2pt_2 = Vector2Pt(PointA=end_3.End, PointB=end_4.Start, Unitize=False)  # -> Vector, Length

cull_i = CullIndex(List=vec2pt_2.Vector, Indices=-1, Wrap=True)

ma = MassAddition(Input=cull_i)  # -> Result, PartialResults
vec_2 = Vector(flatten(ma.PartialResults))
vec_3 = Vector([vec, vec_2])
rev = Reverse(Vector=vec_3)
move = Move(Geometry=crv_9, Motion=rev)  # -> Geometry, Transform
crv_11 = Curve(move.Geometry)

# ----
# Create Interpolate curve and lets user adjust
number_slider_2 = Slider(20000, range=0..100000)
crv_12 = Curve(crv_11)
join = JoinCurves(Curves=crv_12, Preserve=False)
Z = UnitZ(Factor=number_slider_2)
explode_2 = Explode(Curve=join, Recursive=True)  # -> Segments, Vertices
move_2 = Move(Geometry=explode_2.Vertices, Motion=Z)  # -> Geometry, Transform
crv_13 = Curve(join)
pdecon_5 = Deconstruct(Point=explode_2.Vertices)  # -> XComponent, YComponent, ZComponent
end_5 = EndPoints(Curve=crv_13)  # -> Start, End
pt_8 = ConstructPoint(XCoordinate=pdecon_5.XComponent, YCoordinate=pdecon_5.YComponent, ZCoordinate=expr("x*10", pdecon_5.ZComponent))
ln = Line(StartPoint=end_5.Start, EndPoint=end_5.End)
intcrv_2 = Interpolate(Vertices=pt_8, Degree=3, Periodic=False, KnotStyle=1)  # -> Curve, Length, Domain
profile_crv = Curve(intcrv_2.Curve)
crvadjust = AdjustCurve(Curve=profile_crv, Reset=Button())
topography_crv = Curve(intcrv_2.Curve)
profile_crv_2 = Curve(crvadjust)

# ----
# Dimensions
crv_14 = Curve(crv_11)
join_2 = JoinCurves(Curves=crv_14, Preserve=False)
crv_15 = Curve(join_2)
end_6 = EndPoints(Curve=crv_14)  # -> Start, End
end_7 = EndPoints(Curve=crv_15)  # -> Start, End
pdecon_6 = Deconstruct(Point=end_7.Start)  # -> XComponent, YComponent, ZComponent
pdecon_7 = Deconstruct(Point=end_7.End)  # -> XComponent, YComponent, ZComponent
pt_9 = Point(flatten([end_6.Start, end_7.End]))
mid_on_curve = MidOnCurve(crv=crv_14)  # -> flatten(pt)
angle_3 = Angle(VectorA=Vector(0, 1, 0), VectorB=crv_14)  # -> Angle, Reflex
addition_2 = Addition(A=pdecon_6.ZComponent, B=Slider(5000, range=0..10000))
deg_2 = Degrees(Radians=angle_3.Angle)
pt_10 = ConstructPoint(XCoordinate=pdecon_6.XComponent, YCoordinate=pdecon_6.YComponent, ZCoordinate=addition_2)
pt_11 = ConstructPoint(XCoordinate=pdecon_7.XComponent, YCoordinate=pdecon_7.YComponent, ZCoordinate=addition_2)
linedim = LineDimension(Line=crv_14, Text="{0:0.00}", Size=10)
round = Round(number=deg_2, decimals=1)
ln_2 = Line(StartPoint=pt_10, EndPoint=pt_11)
special_text = SpecialTextTag(tag=round, loc=mid_on_curve, siz=10)  # inputs tag: String, loc: Point3d, siz: Double
# ---------- special_text: C# ----------
    if (string.IsNullOrWhiteSpace(tag))
      return;

    _text.Add(tag);
    _point.Add(loc);
    _size.Add(siz);
# ---------- special_text: C# additional code ----------
  private readonly List<string> _text = new List<string>();
  private readonly List<Point3d> _point = new List<Point3d>();
  private readonly List<double> _size = new List<double>();

  public override void BeforeRunScript()
  {
    _text.Clear();
    _point.Clear();
    _size.Clear();
  }

  public override BoundingBox ClippingBox
  {
    get
    {
      return BoundingBox.Empty;
    }
  }
  public override void DrawViewportWires(IGH_PreviewArgs args)
  {
    if (_text.Count == 0)
      return;

    Plane plane;
    args.Viewport.GetFrustumFarPlane(out plane);

    for (int i = 0; i < _text.Count; i++)
    {
      string text = _text[i];
      double size = _size[i];
      Point3d point = _point[i];
      plane.Origin = point;

      // Figure out the size. This means measuring the visible size in the viewport AT the current location.
      double pixPerUnit;
      Rhino.Display.RhinoViewport viewport = args.Viewport;
      viewport.GetWorldToScreenScale(point, out pixPerUnit);

      size = size / pixPerUnit;

      Rhino.Display.Text3d drawText = new Rhino.Display.Text3d(text, plane, size);
      args.Display.Draw3dText(drawText, Color.Firebrick);
      drawText.Dispose();
    }
  }
# ---------- end special_text ----------
serialdim = SerialDimension(Line=ln_2, Points=pt_9, Text="{0:0.00}", Size=300)

# ==== cluster MidOnCurve: Parameter mid on a curve object
crv = ClusterInput()
crv_2 = Curve(crv)
end = EndPoints(Curve=crv_2)  # -> Start, End
mid2pts = MidBetweenTwoPoints(pt=end.Start, pt_2=end.End)
pt = ClusterOutput(mid2pts)

# ==== cluster Round: Rounds Value with number of decimals
number = ClusterInput()  # Number to round
decimals = ClusterInput()  # Number of decimals
_10º = PowerOf10(Value=decimals)
multiplication = Multiplication(A=number, B=_10º)
int = Integer(multiplication)
division = Division(A=int, B=_10º)
nearest = ClusterOutput(division)  # Nearest Value

# ==== cluster MidBetweenTwoPoints: Get the midpoint between two points
pt = ClusterInput()
pt_2 = ClusterInput()
pt_3 = Point(pt)
pt_4 = Point(pt_2)
ln = Line(StartPoint=pt_3, EndPoint=pt_4)
divide = DivideCurve(Curve=ln, Count=2, Kinks=False)  # -> Points, Tangents, Parameters
item = ListItem(List=divide.Points, Index=1, Wrap=True)
pt_5 = Point(item)
pt_6 = ClusterOutput(pt_5)
