# Grasshopper definition testing.gh (Grasshopper 1.0.7)
# plug-ins: RailwayPlanner

profile_crv = Curve(reparameterize(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))
rail_crv = Curve(reparameterize(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))
series = Series(Start=0, Step=Slider(0.001, range=0..0.001), Count=Slider(1001, range=0..10000))
eval = EvaluateCurve(Curve=profile_crv, Parameter=series)  # -> Point, Tangent, Angle
xz = XZPlane(Origin=eval.Point)
pcx = CurvePlane(Curve=rail_crv, Plane=xz)  # -> flatten(Points), ParamsC, ParamsP
xz_2 = XZPlane(Origin=pcx.Points)
pcx_2 = CurvePlane(Curve=profile_crv, Plane=xz_2)  # -> flatten(Points), ParamsC, ParamsP
vec2pt = Vector2Pt(PointA=pcx.Points, PointB=pcx_2.Points, Unitize=False)  # -> Vector, Length
item = ListItem(List=pcx.Points, Index=Slider(1923, range=0..10000), Wrap=True)
pdecon = Deconstruct(Point=vec2pt.Vector)  # -> XComponent, YComponent, ZComponent
hi = HeightIdentifier(ZValue=pdecon.ZComponent)  # -> Low, Mid, High
lng = ListLength(List=pcx.Points)
c_script = CSharpScript(x=hi.Low, y=lng)  # -> out, A; inputs x: list of Int32, y: Int32
# ---------- c_script: C# ----------
    List<List<int>> groupedPts = new List<List<int>>();
    DataTree<int> boolTree = new DataTree<int>();
    List<int> tempList = new List<int>();
    for (int i = 1; i < x.Count; i++)
    {
      if ((x[i] - x[i - 1]) == 1 && i != x.Count - 1)
        tempList.Add(x[i - 1]);
      else if ((x[i] - x[i - 1]) == 1 && i == x.Count - 1)
      {
        tempList.Add(x[i - 1]);
        tempList.Add(x[i]);
        if (x[i] + 1 <= y-1 )
        tempList.Add(x[i] + 1);
      }
      else
      {
        tempList.Add(x[i - 1]);
        tempList.Add(x[i - 1] + 1);
        groupedPts.Add(tempList);
        tempList = new List<int>();
      }
    }

    groupedPts.Add(tempList);
    int pathId = 0;

    foreach (List<int> list in groupedPts)
    {
      GH_Path pth = new GH_Path(pathId);
      foreach (int index in list)
      {
        boolTree.Add(index, pth);
      }

      pathId++;
    }

    A = boolTree;
# ---------- end c_script ----------
c_script_2 = CSharpScript(x=hi.Mid, y=lng)  # -> out, A; inputs x: list of Int32, y: Int32; same code as c_script
c_script_3 = CSharpScript(x=hi.High, y=lng)  # -> out, A; inputs x: list of Int32, y: Int32; same code as c_script
item_2 = ListItem(List=pcx.Points, Index=hi.Mid, Wrap=True)
item_3 = ListItem(List=pcx.Points, Index=c_script.A, Wrap=True)
item_4 = ListItem(List=pcx.Points, Index=c_script_2.A, Wrap=True)
item_5 = ListItem(List=pcx.Points, Index=c_script_3.A, Wrap=True)
intcrv = Interpolate(Vertices=item_3, Degree=3, Periodic=False, KnotStyle=1)  # -> flatten(Curve), Length, Domain
intcrv_2 = Interpolate(Vertices=item_4, Degree=3, Periodic=False, KnotStyle=1)  # -> flatten(Curve), Length, Domain
intcrv_3 = Interpolate(Vertices=item_5, Degree=3, Periodic=False, KnotStyle=1)  # -> flatten(Curve), Length, Domain
Z = UnitZ(Factor=Slider(0.1, range=0..1))
neg = Negative(Value=Z)
move = Move(Geometry=intcrv_3.Curve, Motion=Z)  # -> Geometry, Transform
move_2 = Move(Geometry=intcrv_3.Curve, Motion=neg)  # -> Geometry, Transform
merge = Merge(Data1=intcrv.Curve, Data2=intcrv_2.Curve, Data3=intcrv_3.Curve)  # -> flatten(Result)
move_3 = Move(Geometry=intcrv_2.Curve, Motion=Z)  # -> Geometry, Transform
move_4 = Move(Geometry=intcrv_2.Curve, Motion=neg)  # -> Geometry, Transform
entwine = Entwine(Branch00=move.Geometry, Branch01=move_2.Geometry, FlattenInputs=True)
move_5 = Move(Geometry=intcrv.Curve, Motion=Z)  # -> Geometry, Transform
move_6 = Move(Geometry=intcrv.Curve, Motion=neg)  # -> Geometry, Transform
entwine_2 = Entwine(Branch00=move_3.Geometry, Branch01=move_4.Geometry, FlattenInputs=True)
simplify = SimplifyCurve(Curve=merge)  # -> Curve, Simplified
flip = FlipMatrix(Data=entwine)
entwine_3 = Entwine(Branch00=move_5.Geometry, Branch01=move_6.Geometry, FlattenInputs=True)
flip_2 = FlipMatrix(Data=entwine_2)
crv = Curve(simplify.Curve)
loft = Loft(Curves=flip, Options={Adjust=False, Closed=False, LoftEnds=0, LoftSimp=0, LoftType=0, Rebuild=10, Refit=0.01})  # -> flatten(Loft)
flip_3 = FlipMatrix(Data=entwine_3)
loft_2 = Loft(Curves=flip_2, Options={Adjust=False, Closed=False, LoftEnds=0, LoftSimp=0, LoftType=0, Rebuild=10, Refit=0.01})  # -> flatten(Loft)
loft_3 = Loft(Curves=flip_3, Options={Adjust=False, Closed=False, LoftEnds=0, LoftSimp=0, LoftType=0, Rebuild=10, Refit=0.01})  # -> flatten(Loft)
preview = CustomPreview(Geometry=loft, Material=ColourSwatch(SwatchColor=RGB(255, 97, 97)))
preview_2 = CustomPreview(Geometry=loft_2, Material=ColourSwatch(SwatchColor=RGB(232, 252, 101)))
preview_3 = CustomPreview(Geometry=loft_3, Material=ColourSwatch(SwatchColor=RGB(81, 240, 142)))
